# Grasshopper definition tweetLandscape.ghx (Grasshopper 0.9.76)
# plug-ins: ghJSON

tweet_count_per_hash_x = Slider(10, range=0..10)
tweet_count_per_hash_y = Slider(10, range=0..10)
file_path = Panel("D:\Dropbox\Jose Luis\Twipology\10 - DEV\twipology\tweetData\1425684770859_tweets_parsed.json")
hash_count_x = Slider(4, range=0..10)
hash_count_y = Slider(3, range=0..10)
tweet_base_height_mm = Slider(10, range=0..100)
character_height_mm = Slider(5, range=0..50)
max_total_height_mm = Slider(150, range=0..500)
noise_amplitude_mm = Slider(25, range=0..50)
tweet_size_x_mm = Slider(100, range=0..500)
tweet_size_y_mm = Slider(150, range=0..500)
height_gradient_directions_in_degs = Panel("""180
210
270
240
150
90
300
330
120
60
30
0""")
dam = DataDam(DataA=character_height_mm, BufferDelay=20000000, BufferMode=2)
dam_2 = DataDam(DataA=file_path, BufferDelay=20000000, BufferMode=2)

file = ReadFile(File=dam_2, PerLineParse=False)
txt = Text(file)

# ----
# USING ghJSON FOR GH:
# http://mathrioshka.ru/ghjson/
panel = Panel("{\"hashArray\":")
concat = Concatenate(FragmentA=panel, FragmentB=txt, FragmentC="}")
frmjson = FromJSON(JSON=concat)

jpath = JSONPath(JObject=frmjson, JSONPathQuery="$.hashArray[*].hashtag")
hashtags = Text(simplify(graft(jpath)))

lng = ListLength(List=jpath)
series = Series(Start=0, Step=1, Count=lng)
int = Integer(series)

concat_2 = Concatenate(FragmentA="$.hashArray[", FragmentB=int, FragmentC="].tweets[*].hashtag_count")
jpath_2 = JSONPath(JObject=frmjson, JSONPathQuery=concat_2)
hashtag_count = Text(simplify(jpath_2))

concat_3 = Concatenate(FragmentA="$.hashArray[", FragmentB=int, FragmentC="].tweets[*].text")
jpath_3 = JSONPath(JObject=frmjson, JSONPathQuery=concat_3)
tweet_text = Text(simplify(jpath_3))

panel_2 = Panel(hashtag_count)
c_script = CSharpScript(
    hashCountX=hash_count_x,
    hashCountY=hash_count_y,
    tweetCountHashX=tweet_count_per_hash_x,
    tweetCountHashY=tweet_count_per_hash_y,
    tweetSizeX=tweet_size_x_mm,
    tweetSizeY=tweet_size_y_mm,
    tweetBaseHeight=tweet_base_height_mm,
    hashtags=hashtags,
    hashtagCount=hashtag_count,
    tweetText=tweet_text,
    charHeight=dam,
    maxHeight=max_total_height_mm,
    noiseAmplitude=noise_amplitude_mm)  # -> out, meshes, A, B, C, D; inputs hashCountX: Int32, hashCountY: Int32, tweetCountHashX: Int32, tweetCountHashY: Int32, tweetSizeX: Double, tweetSizeY: Double, tweetBaseHeight: Double, hashtags: tree of String, hashtagCount: tree of Int32, tweetText: tree of String, charHeight: Double, maxHeight: Double, noiseAmplitude: Double
# ---------- c_script: C# ----------
    DataTree<Tweet> tweets = new DataTree<Tweet>();

    // iterate over hashtag blocks
    for (int V = 0; V < hashCountY; V++) {
      for (int U = 0; U < hashCountX; U++) {
        int UV = V * hashCountX + U;
        GH_Path UVpath = new GH_Path(UV);

        List<Tweet> twts = new List<Tweet>();
        List<string> tweetTxt = tweetText.Branch(UVpath);
        List<int> hashtagCnt = hashtagCount.Branch(UVpath);
        string hash = hashtags.Branch(UVpath)[0];

        // iterate over tweets in hashtag block
        for (int v = 0; v < tweetCountHashY; v++) {
          for (int u = 0; u < tweetCountHashX; u++) {
            int uv = v * tweetCountHashX + u;

            double x_ = U * tweetCountHashX * tweetSizeX + u * tweetSizeX;
            double y_ = V * tweetCountHashY * tweetSizeY + v * tweetSizeY;
            double z_ = 0;
            double baseElev = tweetBaseHeight;
            string txt = tweetTxt[uv];
            int htC = hashtagCnt[uv];

            Tweet T = new Tweet(UV, uv, x_, y_, z_, tweetSizeX, tweetSizeY, baseElev, charHeight, maxHeight, noiseAmplitude, hash, htC, txt);
            twts.Add(T);
          }
        }
        
        // Sort the list according to rounded average chars and then char amplitude
        // http://stackoverflow.com/a/3309397/1934487
        twts.Sort(delegate(Tweet t1, Tweet t2) {
            int compareAvg = t1.compareheightAverageInt(t2);
            if (compareAvg == 0) {
              return t1.compareheightAmplitude(t2);  
            }
            return compareAvg;
        });
 
        tweets.AddRange(twts, UVpath);
      }
    }




    // Do something with the tweets TEMP
    DataTree<Point3d> tweetAnchors = new DataTree<Point3d>();
    DataTree<Mesh> tweetMeshes = new DataTree<Mesh>();
    DataTree<double> tweetAvgs = new DataTree<double>();
    DataTree<int> tweetAvgsInt = new DataTree<int>();
    DataTree<double> tweetAmp = new DataTree<double>();
    
    // iterate over hashtag blocks
    for (int V = 0; V < hashCountY; V++) {
      for (int U = 0; U < hashCountX; U++) {
        int UV = V * hashCountX + U;
        GH_Path UVpath = new GH_Path(UV);
        List<Tweet> tweetList = tweets.Branch(UVpath);

        // iterate over tweets in hashtag block
        for (int v = 0; v < tweetCountHashY; v++) {
          for (int u = 0; u < tweetCountHashX; u++) {
            int uv = v * tweetCountHashX + u;
            GH_Path uvpath = new GH_Path(UV, uv);

            tweetAnchors.Add(tweetList[uv].anchor, UVpath);
            tweetMeshes.Add(tweetList[uv].mesh, UVpath);
            tweetAvgs.Add(tweetList[uv].heightAverage, UVpath);
            tweetAvgsInt.Add(tweetList[uv].heightAverageInt, UVpath);
            tweetAmp.Add(tweetList[uv].heightAmplitude, UVpath);

          }
        }

      }
    }


    meshes = tweetMeshes;
    A = tweetAnchors;
    B = tweetAvgs;
    C = tweetAvgsInt;
    D = tweetAmp;
# ---------- c_script: C# additional code ----------
  public static Random random = new Random();

  class Tweet {

    public int hashId, tweetId;

    public double x, y, z;
    public Point3d anchor;
    public double width, height;
    public double baseElevation, charHeight, maxHeight, noiseAmp;

    public string hashtag;
    public int hashtagCount;
    public string text;
    public int textLength;
    public int wordCount;
    public string[] words;
    public int[] wordChars;
    public double heightMin, heightMax, heightAverage, heightAmplitude;
    public int heightAverageInt;  // an imposed rounding to categorize all similar avgs by amplitude

    public Mesh mesh = new Mesh();

    public Tweet(int hashId_, int tweetId_, double x_, double y_, double z_, double w, double h, double baseElev, double charH, double maxH, double noiseAmp_, string hash, int hashtagCount_, string txt) {
      hashId = hashId_;
      tweetId = tweetId_;
      x = x_;
      y = y_;
      z = z_;
      anchor = new Point3d(x, y, z);
      width = w;
      height = h;
      baseElevation = baseElev;
      charHeight = charH;
      maxHeight = maxH;
      noiseAmp = noiseAmp_;
      hashtag = hash;
      hashtagCount = hashtagCount_;
      text = txt;

      parseText();
      computeWave();
      generateMesh();
    }
  
    // Read word count, chars per count, etc.
    void parseText() {
      textLength = text.Length;
      words = text.Split(new Char [] {' '});
      wordCount = words.Length;
      wordChars = new int[wordCount];
      for (int i = 0; i < wordCount; i++) {
        wordChars[i] = words[i].Length;
      }
    }
  
    // Compute average and amplitude
    void computeWave() {
      heightMin = Double.MaxValue;
      heightMax = 0;
      heightAverage = 0;
      for (int i = 0; i < wordChars.Length; i++) {
        int val = wordChars[i];
        if (val > heightMax) heightMax = val;
        if (val < heightMin) heightMin = val;
        heightAverage += val;
      }
      heightAverage /= wordChars.Length;
      heightAverageInt = (int) (Math.Round(heightAverage));
      heightAmplitude = heightMax - heightMin;
    }
    
    // Generate representing mesh
    void generateMesh() {
      // some sanity
      if (wordCount == 0) {
        generatePlanarMesh(baseElevation);
        return;
      }
      if (wordCount == 1) {
        generatePlanarMesh(baseElevation + wordChars[0] * charHeight);
        return;
      }

      // mesh with +1 words
      bool addNoise = true;
      int stepsX = hashtagCount - 1;
      if (stepsX == 0) {  // if tweet has only one hashtag, don't add noise
        addNoise = false;
        stepsX = 1;
      }
      double gapX = width / stepsX;
      int stepsY = wordCount - 1;
      double gapY = height / stepsY;
      List<Point3d> verts = new List<Point3d>();
      // iterate in Y direction
      for (int i = 0; i < wordCount; i++) {
        for (int j = 0; j < stepsX + 1; j++) {
          double xi = x + gapX * j;
          double yi = y + gapY * i;
          double zi = baseElevation + wordChars[i] * charHeight;
          if (addNoise) {
            zi += noiseAmp * (random.NextDouble() - 0.5);
          }
          if (zi > maxHeight) zi = maxHeight;
          verts.Add(new Point3d(xi, yi, zi));
          //verts.Add(new Point3d(x, yi, zi));
          //verts.Add(new Point3d(x + width, yi, zi));
        }
      }
      mesh.Vertices.AddVertices(verts);


      for (int i = 0; i < wordCount - 1; i++) {
        for (int j = 0; j < stepsX; j++) {
          int dist = stepsX + 1;
          int uv = dist * i + j;
          mesh.Faces.AddFace(uv, uv + 1, uv + dist + 1, uv + dist);
        }
      }


      mesh.Normals.ComputeNormals();
      mesh.FaceNormals.ComputeFaceNormals();

    }

    // For the case of 0-1 words per tweet
    void generatePlanarMesh(double elevation) {
      List<Point3d> verts = new List<Point3d>();
      verts.Add(new Point3d(anchor.X, anchor.Y, anchor.Z + elevation));
      verts.Add(new Point3d(anchor.X + width, anchor.Y, anchor.Z + elevation));
      verts.Add(new Point3d(anchor.X + width, anchor.Y + height, anchor.Z + elevation));
      verts.Add(new Point3d(anchor.X, anchor.Y + height, anchor.Z + elevation));
      mesh.Vertices.AddVertices(verts);

      mesh.Faces.AddFace(0, 1, 2, 3);

      mesh.Normals.ComputeNormals();
      mesh.FaceNormals.ComputeFaceNormals();

    }
    
    // Some comparator functions
    public int compareheightAverageInt(Tweet other) {
      if (other.heightAverageInt < this.heightAverageInt) {
        return 1;
      }
      if (other.heightAverageInt == this.heightAverageInt) {
        return 0;
      }
      return -1;
    }
    public int compareheightAmplitude(Tweet other) {
      if (other.heightAmplitude < this.heightAmplitude) {
        return 1;
      }
      if (other.heightAmplitude == this.heightAmplitude) {
        return 0;
      }
      return -1;
    }

  }
# ---------- end c_script ----------
panel_3 = Panel(c_script.B)
geo = Geometry(c_script.A)
geo_2 = Geometry(c_script.meshes)
panel_4 = Panel(c_script.out)
panel_5 = Panel(c_script.C)
flatten = FlattenTree(Tree=geo_2, Path="{0}")
panel_6 = Panel(c_script.D)
viewer = ParamViewer(c_script.A)
item = ListItem(List=flatten, Index=Slider(329, range=0..1000), Wrap=True)
